# Grasshopper definition Part_03-01_box morph mesh.gh (Grasshopper 1.0.5)
# Copyright: Co-de-iT
# plug-ins: Human, Weaverbird

# single face (for testing)
mesh = Mesh(<mesh referenced from the Rhino model>)
# actual mesh
mesh_2 = Mesh(<mesh referenced from the Rhino model>)
# field curves
crv = Curve([<curve referenced from the Rhino model> x2])
wbcatmullclark = WeaverbirdsCatmullClarkSubdivision(MeshCurves=mesh_2, Level=Slider(3, range=1..3), SmoothNakedEdges=Slider(2, range=0..2))

demesh = DeconstructMesh(Mesh=wbcatmullclark)  # -> Vertices, Faces, Colours, Normals
deface = DeconstructFace(Face=graft(demesh.Faces))  # -> CornerA, CornerB, CornerC, CornerD
merge = Merge(Data1=deface.CornerA, Data2=deface.CornerB, Data3=deface.CornerC, Data4=deface.CornerD)
# find the 4 vertices and normals
# for each face
item = ListItem(List=demesh.Vertices, Index=merge, Wrap=True)  # -> simplify(Item)
item_2 = ListItem(List=demesh.Normals, Index=merge, Wrap=True)  # -> simplify(Item)

X = UnitX(Factor="-10")

# ----
# <title>
# 
# <description>
# 
# code by <author>
# 
# v <version>
# 
# © Co-de-iT 2018 _ Creative Commons Attribution-NonCommercial-ShareAlike 4.0 International License
mesh_3 = Mesh(<mesh referenced from the Rhino model>)
mesh_4 = Mesh([<mesh referenced from the Rhino model> x5])

vertex_offset = Slider(3.132, range=0..5)
amp = Amplitude(Vector=item_2, Amplitude=vertex_offset)
move = Move(Geometry=item, Motion=amp)  # -> Geometry, Transform
# move vertices and create
# twisted boxes
item_3 = ListItem(List=item, Index=0, Wrap=True)  # -> Item, Item1, Item2, Item3
item_4 = ListItem(List=move.Geometry, Index=0, Wrap=True)  # -> Item, Item1, Item2, Item3
tbox = TwistedBox(
    CornerA=item_3.Item,
    CornerB=item_3.Item1,
    CornerC=item_3.Item2,
    CornerD=item_3.Item3,
    CornerE=item_4.Item,
    CornerF=item_4.Item1,
    CornerG=item_4.Item2,
    CornerH=item_4.Item3)  # -> flatten(TwistedBox)

# ----
# vector field per face
avr = Average(Input=item)
divlength = DivideLength(Curve=crv, Length=Slider(1, range=0.05..2))  # -> flatten(Points), flatten(Tangents), Parameters
cp = ClosestPoint(Point=avr, Cloud=divlength.Points)  # -> ClosestPoint, CPIndex, Distance
item_5 = ListItem(List=divlength.Tangents, Index=cp.CPIndex, Wrap=True)
vdisex = VectorDisplayEx(Point=avr, Vector=item_5, Colour=item_5, Width=2)

# ----
# I need a reference direction for each mesh face (this can be the Millipede field)
item_6 = ListItem(List=item, Index=0, Wrap=True)  # -> Item, Item1, Item2, Item3
avr_2 = Average(Input=[item_6.Item2, item_6.Item3])
ln = Line(StartPoint=avr, EndPoint=avr_2)

move_2 = Move(Geometry=mesh_3, Motion=X)  # -> Geometry, Transform
wbjoin = WeaverbirdsJoinMeshesAndWeld(Mesh=move_2.Geometry, Weld=True)

crv_2 = Curve([<curve referenced from the Rhino model> x6])
bbox = BoundingBox(Content=crv_2, Plane=PlaneXY(0, 0, 0), UnionBox=True)  # -> Box, Box_2

# ----
# component geometry
# reference bounding box
merge_2 = Merge(Data1=wbjoin)
group = Group(Objects=merge_2)

unit = UnitVector(Vector=ln)

# ----
# orient by minimum angle
angle = Angle(VectorA=item_5, VectorB=unit)  # -> Angle, Reflex
sin = Sine(Value=angle.Angle)
abs = Absolute(Value=sin)
larger = LargerThan(FirstNumber=abs, SecondNumber="0.5")  # -> LargerThan, OrEqualTo

box = EvaluateBox(Box=bbox.Box, UParameter=0.5, VParameter=0.5, WParameter=0.5)  # -> Plane, Point, Include
# generates 2 possible component rotations, using the Bounding Box: 0 and 90° (compliant or perpendicular to the vector field)
panel = Panel("0 to Pi")
range = Range(Domain=panel, Steps="2")
cull_i = CullIndex(List=range, Indices="-1", Wrap=True)
Z = UnitZ(Factor=1)
rot3d = Rotate3D(Geometry=bbox.Box, Angle=cull_i, Center=box.Point, Axis=Z)  # -> flatten(Geometry), Transform

int = Integer(flatten(larger.LargerThan))
panel_2 = Panel(int)
item_7 = ListItem(List=rot3d.Geometry, Index=int, Wrap=True)
morph = BoxMorph(Geometry=group, Reference=item_7, Target=tbox)
ungroup = Ungroup(Group=morph)

split = SplitList(List=ungroup, Index="1")  # -> ListA, ListB
mjoin = MeshJoin(Meshes=flatten(split.ListA))
crv_3 = Curve(split.ListB)
previewlw = CustomPreviewLineweights(Geometry=crv_3, Shader=ColourSwatch(SwatchColor=RGB(0, 0, 0)), Absolute=False)

mesh_5 = Mesh(mjoin)

medges = MeshEdges(Mesh=mesh_5)  # -> NakedEdges, InteriorEdges, NonManifoldEdges
preview = CustomPreview(Geometry=mesh_5, Material=ColourSwatch(SwatchColor=RGB(255, 255, 255)))
