# Grasshopper definition Part_04-Ivy_00 mesh graph structure_basic.gh (Grasshopper 1.0.5)
# plug-ins: MeshEdit Components, Human, Ivy, Weaverbird

# ---- group: mesh from surface
# . choose a mesh (use it like a surface)
# . choose a segmentation diagram
# . choose fields (stress and/or other)
# . generate implied structure
number_slider = Slider(6, range=2..50)
srf = Surface(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)
mesh_uv = MeshSurface(Surface=srf, UCount=number_slider, VCount=number_slider, Overhang=True, Equalize=False)
tri = Triangulate(Mesh=mesh_uv)  # -> Mesh, Count
weldvertices = MeshWeldVertices(Mesh=tri.Mesh, Tolerance=0.01)  # -> RuntimeMessage, Mesh
flip = MeshFlip(Mesh=weldvertices.Mesh)

# ----
# <title>
# 
# <description>
# 
# code by <author>
# 
# v <version>
# 
# © Co-de-iT 2018 _ Creative Commons Attribution-NonCommercial-ShareAlike 4.0 International License
mesh = Mesh(flip)
percent = Slider(0.229, range=0..1)
facen = FaceNormals(Mesh=mesh)  # -> Centers, Normals
lng = ListLength(List=facen.Centers)  # -> expr("x-1", Length)

# ---- group: generate mesh graph
# this is the mesh dual graph - connectivity graph
grphmsh = GraphFromMesh(InputMesh=mesh)

# ----
multiplication = Multiplication(A=lng, B=percent)
mesh_2 = Mesh(mesh)

# ---- group: midpoint distance weights
mdistweight = FaceMidpointDistanceEdgeWeight(MeshGraph=grphmsh)

# ---- group: face angles weight
faweight = FaceAngleEdgeWeight(MeshGraph=grphmsh)

# ---- group: face size weight
fsfaceweight = FaceSizeNodeMeshFaceWeight(MeshGraph=grphmsh)

# ----
int = Integer(multiplication)

# ---- group: generate spanning tree from graph
mstk = MSTKruskal(MeshGraph=faweight)
mstd = MSTDjikstra(MeshGraph=faweight, StartFace=int)
dfsedge = DFSEdgeWeight(MeshGraph=faweight, StartFace=int)

# ----
mgraph = MeshGraph(mstk, EnhancedType=0, MeshView=False, NodeGeoView=False)

# ----
# info on nodes
number_slider_2 = Slider(0.139, range=0..1)
nodes = GraphNodes(MeshGraph=mgraph)  # -> MeshId, Point, Weight, Edges, Neighbors, Depth, NodeObject
nodes_id_faces_id = Panel(nodes.MeshId)
graph_face_neighbors = Panel(nodes.Neighbors)
node_depth_steps_from_leaf = Panel(nodes.Depth)
graph_edges_id_connecting_to_the_node = Panel(nodes.Edges)

# ----
# info on graph edges
edges = GraphEdges(MeshGraph=mgraph)  # -> MeshId, GraphEdge, TopoEdge, Weight, Nodes, Angle, Bend
graph_topology_edge = Panel(edges.GraphEdge)
mesh_topology_edge_index = Panel(edges.MeshId)
mesh_edges_affected_by_graph = Panel(edges.TopoEdge)
nodes_id_mesh_faces_id_connected_by_each = Panel(edges.Nodes)  # "nodes id (mesh faces id) connected by each graph polyline"
angle_between_faces = Panel(edges.Angle)
bend_type_1_flat_2_convex_3_concave = Panel(edges.Bend)
edge_weights = Panel(edges.Weight)

# ---- group: mesh face index/node index
tag = TextTag3D(
    Location=nodes.Point,
    Text=nodes.MeshId,
    Size=number_slider_2,
    Colour=ColourSwatch(SwatchColor=RGB(0, 0, 0)),
    Justification=5)

# ---- group: node weights
tag_2 = TextTag3D(Location=nodes.Point, Text=nodes.Weight, Size=number_slider_2, Justification=5)

# ---- group: visualize face center
item = ListItem(List=facen.Centers, Index=int, Wrap=True)

# ----
mgraph_2 = MeshGraph(mstk, EnhancedType=0, MeshView=False, NodeGeoView=False)

# ---- group: all mesh edges in topological order
c_script = CSharpScript(M=mesh_2)  # -> E; inputs M: Mesh
# ---------- c_script: C# ----------
    if (M == null) return;
    List<Line> edgeLines = new List<Line>(M.TopologyEdges.Count);
    for(int i = 0; i < M.TopologyEdges.Count; i++) edgeLines.Add(M.TopologyEdges.EdgeLine(i));
    E = edgeLines;
# ---------- end c_script ----------

# ----
# there is a mistake here:
# 
# Id pop up says id contains the number Id (index) of the corresponding mesh faces (which does not make sense). Instead, it is the index of the corresponding mesh (topological) EDGES
edges_2 = GraphEdges(MeshGraph=mgraph_2)  # -> MeshId, GraphEdge, TopoEdge, Weight, Nodes, Angle, Bend

# ---- group: topology edges lines
# these are also the indexes of the faces shared by each edge interested by the graph
crv = Curve(edges.TopoEdge)

# ----
number_slider_3 = Slider(0, range=0..10)
panel = Panel(c_script)

# ---- group: reproducing the graph with custom height / extract edge line by topology edge index
c_script_2 = CSharpScript(M=mesh_2, i=edges_2.MeshId)  # -> out, E; inputs M: Mesh, i: Int32
# ---------- c_script_2: C# ----------
    if (M == null || i >= M.TopologyEdges.Count) return;
      E = M.TopologyEdges.EdgeLine(i);
# ---------- end c_script_2 ----------

# ---- group: reproducing the graph with custom height
number_slider_4 = Slider(0, range=0..2)
facen_2 = FaceNormals(Mesh=mesh_2)  # -> Centers, Normals
curvepoint = PointOnCurve(c_script_2.E, parameter=0.5)
amp = Amplitude(Vector=facen_2.Normals, Amplitude=number_slider_4)
move = Move(Geometry=facen_2.Centers, Motion=amp)  # -> Geometry, Transform
item_2 = ListItem(List=facen_2.Normals, Index=edges_2.Nodes, Wrap=True)
item_3 = ListItem(List=move.Geometry, Index=edges_2.Nodes, Wrap=True)
avr = Average(Input=item_2)
amp_2 = Amplitude(Vector=avr, Amplitude=number_slider_4)
move_2 = Move(Geometry=curvepoint, Motion=amp_2)  # -> Geometry, Transform
ins = InsertItems(List=item_3, Item=move_2.Geometry, Indices="1", Wrap=True)
pline = PolyLine(Vertices=ins, Closed=False)

# ----
subtraction = Subtraction(A=edges.Bend, B="1")
merge = Merge(
    Data1=ColourSwatch(SwatchColor=RGB(255, 255, 255)),
    Data2=ColourSwatch(SwatchColor=RGB(255, 0, 0)),
    Data3=ColourSwatch(SwatchColor=RGB(0, 55, 255)))

# ---- group: coresponding topology edge index
f_sbpath = SerialBranchPath(T=edges_2.MeshId, i=number_slider_3)  # -> P, D; inputs T: tree, i: Int32
# ---------- f_sbpath: C# ----------
                                            /*
    froGH - a sparse collection of (in)utilities for Grasshopper

    Serial Branch Path
    code by Alessio Erioli

    froGH by Co-de-iT is licensed under a Creative Commons Attribution 4.0 International License.
    http://creativecommons.org/licenses/by/4.0/

    */

    initComp();


    if (T.BranchCount > 0){
      int ind = i % T.BranchCount;
      P = T.Path(ind);
      D = T.Branches[ind];
    }
# ---------- f_sbpath: C# additional code ----------
  void initComp(){
    Component.Name = "Serial Branch Path";
    Component.NickName = "f_SBPath";
    Component.Description = "Retrieves the data tree path and data for a specific branch serial index";
    Component.Params.Input[0].Name = "Tree";
    Component.Params.Input[0].Description = "the data tree";
    Component.Params.Input[1].Name = "index";
    Component.Params.Input[1].Description = "serial index of branch to sample";
    Component.Params.Output[0].Name = "Path";
    Component.Params.Output[0].Description = "the tree branch path";
    Component.Params.Output[1].Name = "Data";
    Component.Params.Output[1].Description = "the tree branch content";
  }
# ---------- end f_sbpath ----------

# ----
cset = CreateSet(List=flatten(edges_2.MeshId))  # -> Set, Map
f_mebyf = EdgesByFace(M=mesh_2)  # -> i, E; inputs M: Mesh
# ---------- f_mebyf: C# ----------
    /*
    froGH - a sparse collection of (in)utilities for Grasshopper

    Map Mesh Edges by Face

    code by Alessio Erioli

    froGH by Co-de-iT is licensed under a Creative Commons Attribution 4.0 International License.
    http://creativecommons.org/licenses/by/4.0/

    */

    initComp();


    if (M != null){
      DataTree<Line> edges = new DataTree<Line>();
      DataTree<int> edgeInd = new DataTree<int>();
      GH_Path p;
      int[] edgesFInd;
      for (int k = 0; k < M.Faces.Count; k++){
        p = new GH_Path(k);
        edgesFInd = M.TopologyEdges.GetEdgesForFace(k);
        edgeInd.AddRange(edgesFInd, p);
        for (int j = 0; j < edgesFInd.Length; j++){
          edges.Add(M.TopologyEdges.EdgeLine(edgesFInd[j]), p);
        }
      }
      i = edgeInd;
      E = edges;
    }
# ---------- f_mebyf: C# additional code ----------
  void initComp(){
    Component.Name = "Edges by Face";
    Component.NickName = "f_MEbyF";
    Component.Description = "Outputs mesh edges (as lines and indexes) sorted by face";
    Component.Params.Input[0].Name = "Mesh";
    Component.Params.Input[0].Description = "Input Mesh";
    Component.Params.Output[0].Name = "Edges indexes";
    Component.Params.Output[0].Description = "Edges indexes sorted by face";
    Component.Params.Output[1].Name = "Edge lines";
    Component.Params.Output[1].Description = "Edge lines sorted by face";
  }
# ---------- end f_mebyf ----------
item_4 = ListItem(List=merge, Index=subtraction, Wrap=True)

# ---- group: topology edge index
curvepoint_2 = PointOnCurve(edges_2.GraphEdge, parameter=0.5)
tag_3 = TextTag3D(
    Location=curvepoint_2,
    Text=edges_2.MeshId,
    Size=Slider(0.084, range=0..1),
    Colour=ColourSwatch(SwatchColor=RGB(255, 255, 255)),
    Justification=5)

# ---- group: extract edge line by topology edge index
c_script_3 = CSharpScript(M=mesh_2, i=f_sbpath.D)  # -> out, E; inputs M: Mesh, i: Int32; same code as c_script_2
crv_2 = Curve(c_script_3.E)

# ---- group: topology edge
f_sbpath_2 = SerialBranchPath(T=edges_2.GraphEdge, i=number_slider_3)  # -> P, D; inputs T: tree, i: Int32; same code as f_sbpath
crv_3 = Curve(f_sbpath_2.D)

# ----
intersection = SetIntersection(SetA=f_mebyf.i, SetB=cset.Set)
difference = SetDifference(SetA=f_mebyf.i, SetB=cset.Set)
mesh_connected_edges_by_face = Panel(intersection)
remaining_edges_by_face = Panel(difference)
previewlw = CustomPreviewLineweights(Geometry=crv, Shader=item_4, Thickness=Slider(4, range=1..5), Absolute=False)

# ---- group: faces centers and normals
facen_3 = FaceNormals(Mesh=mesh_2)  # -> graft(Centers), graft(Normals)

# ---- group: remaining edges
c_script_4 = CSharpScript(M=mesh_2, i=difference)  # -> out, E; inputs M: Mesh
# ---------- c_script_4: C# ----------
    if (M == null || i == null || (int) i >= M.TopologyEdges.Count) return;

    E = M.TopologyEdges.EdgeLine((int) i);
# ---------- end c_script_4 ----------

# ---- group: edges interesed in graph sorted by mesh face
c_script_5 = CSharpScript(M=mesh_2, i=intersection)  # -> out, E; inputs M: Mesh; same code as c_script_4

# ---- group: all mesh edges in topological order
c_script_6 = CSharpScript(M=mesh_2)  # -> E; inputs M: Mesh; same code as c_script

# ---- group: attractor for height
pt = Point([Point(-1.710163166, -14.14691698, 0), Point(5.3465951, -7.118636667, 0)])
meshcp = MeshClosestPoint(Point=pt, Mesh=mesh_2)  # -> Point, Index, Parameter
dist = Distance(PointA=facen_3.Centers, PointB=meshcp.Point)
addition = Addition(A=dist, B="0.001")
one_over_x = OneOverX(Value=addition)
sqrt = SquareRoot(Value=one_over_x)
avr_2 = Average(Input=sqrt)
sqrt_2 = SquareRoot(Value=avr_2)
num = Number(sqrt_2)
bnd = Bounds(Numbers=flatten(num))
remap = RemapNumbers(Value=num, Source=bnd, Target=Domain(0, 1))  # -> Mapped, Clipped

# ---- group: displace face centers
max_displace = Slider(2.024, range=0..3)
min_displace = Slider(0.01, range=0..10)
num_2 = Number(remap.Mapped)
bnd_2 = Bounds(Numbers=flatten(num_2))
dom = ConstructDomain(DomainStart=min_displace, DomainEnd=max_displace)
remap_2 = RemapNumbers(Value=num_2, Source=bnd_2, Target=dom)  # -> Mapped, Clipped
amp_3 = Amplitude(Vector=facen_3.Normals, Amplitude=remap_2.Mapped)

# ---- group: edge parameters
structure_thinning = Slider(0.4, range=0.001..0.499)
subtraction_2 = Subtraction(A="1", B=structure_thinning)
merge_2 = Merge(Data1="0", Data2=structure_thinning, Data3=".5", Data4=subtraction_2, Data5="1")

# ---- group: displace face centers / displaced face centers
move_3 = Move(Geometry=facen_3.Centers, Motion=amp_3)  # -> Geometry, Transform

# ---- group: other edges / faces connected to an edge
f_mecf = EdgeConnectedFaces(M=mesh_2, i=intersection)  # -> E, simplify(F); inputs M: Mesh, i: Int32
# ---------- f_mecf: C# ----------
     /*
    froGH - a sparse collection of (in)utilities for Grasshopper

    Mesh Faces connected to a specific Edge

    code by Alessio Erioli

    froGH by Co-de-iT is licensed under a Creative Commons Attribution 4.0 International License.
    http://creativecommons.org/licenses/by/4.0/

    */

    initComp();

    if (M != null && i < M.TopologyEdges.Count){
      E = M.TopologyEdges.EdgeLine(i);

      F = M.TopologyEdges.GetConnectedFaces(i);

    }
# ---------- f_mecf: C# additional code ----------
  void initComp(){
    Component.Name = "Edge connected faces";
    Component.NickName = "f_MEcF";
    Component.Description = "Gets indexes of connected faces to a specific edge";
    Component.Params.Input[0].Name = "Mesh";
    Component.Params.Input[0].Description = "Input Mesh";
    Component.Params.Input[1].Name = "Egde index";
    Component.Params.Input[1].Description = "index of edge to sample";
    Component.Params.Output[0].Name = "Edge line";
    Component.Params.Output[0].Description = "Selected Edge as line";
    Component.Params.Output[1].Name = "Face indexes";
    Component.Params.Output[1].Description = "Indexes of faces shared by selected edge";
  }
# ---------- end f_mecf ----------

# ---- group: other edges / displaced graph edge midpoints
item_5 = ListItem(List=flatten(move_3.Geometry), Index=f_mecf.F, Wrap=True)
avr_3 = Average(Input=item_5)

# ----
multiplication_2 = Multiplication(A=structure_thinning, B="2")
swatch = ColourSwatch(SwatchColor=RGB(255, 255, 255))
swatch_2 = ColourSwatch(SwatchColor=RGB(255, 0, 0))
merge_3 = Merge(
    Data1=swatch,
    Data2=swatch,
    Data3=swatch,
    Data4=swatch,
    Data5=swatch,
    Data6=swatch,
    Data7=swatch,
    Data8=swatch,
    Data9=swatch_2)
merge_4 = Merge(
    Data1=swatch,
    Data2=swatch,
    Data3=swatch_2,
    Data4=swatch,
    Data5=swatch,
    Data6=swatch,
    Data7=swatch_2,
    Data8=swatch,
    Data9=swatch_2)

# ---- group: graph edges
clean = CleanTree(RemoveNulls=True, RemoveInvalid=True, RemoveEmpty=False, Tree=c_script_4.E)
lng_2 = ListLength(List=clean)
eval = EvaluateCurve(Curve=reparameterize(simplify(graft(c_script_4.E))), Parameter=merge_2)  # -> Point, Tangent, Angle
item_6 = ListItem(List=eval.Point, Index=0, Wrap=True)  # -> Item, Item1, Item2, Item3, Item4
num_3 = Number(multiplication_2)
subtraction_3 = Subtraction(A="1", B=num_3)
panel_2 = Panel("""T{0;5;1}
Q{1;5;6;2}
T{5;8;6}
T{4;3;7}
Q{2;6;7;3}
T{7;6;8}""")

# ---- group: graph edges / face centers
dup = DuplicateData(Data=facen_3.Centers, Number=lng_2, Order=True)  # -> simplify(graft(Data))

# ---- group: graph edges / displaced face centers
dup_2 = DuplicateData(Data=move_3.Geometry, Number=lng_2, Order=True)  # -> simplify(graft(Data))

# ---- group: graph edges / face normals (not used here)
dup_3 = DuplicateData(Data=facen_3.Normals, Number=lng_2, Order=True)  # -> simplify(graft(Data)); disabled

# ---- group: other edges
# uses the average point between neighbour faces
lng_3 = ListLength(List=c_script_5.E)
eval_2 = EvaluateCurve(Curve=reparameterize(simplify(graft(c_script_5.E))), Parameter=merge_2)  # -> Point, Tangent, Angle
item_7 = ListItem(List=eval_2.Point, Index=0, Wrap=True)  # -> Item, Item1, Item2, Item3, Item4
num_4 = Number(multiplication_2)
subtraction_4 = Subtraction(A="1", B=num_4)
panel_3 = Panel("""T{0;5;1}
Q{1;5;6;2}
T{5;8;6}
T{4;3;7}
Q{2;6;7;3}
T{7;6;8}""")

# ---- group: other edges / face centers
dup_4 = DuplicateData(Data=facen_3.Centers, Number=lng_3, Order=True)  # -> simplify(graft(Data))

# ---- group: other edges / displaced face centers
dup_5 = DuplicateData(Data=move_3.Geometry, Number=lng_3, Order=True)  # -> simplify(graft(Data))

# ---- group: other edges / face normals (not used here)
dup_6 = DuplicateData(Data=facen_3.Normals, Number=lng_3, Order=True)  # -> simplify(graft(Data)); disabled

# ---- group: other edges (continued)
merge_5 = Merge(Data1=dup_4, Data2=item_7.Item)
merge_6 = Merge(Data1=dup_5, Data2=avr_3)
merge_7 = Merge(Data1=dup_4, Data2=item_7.Item4)
interp = InterpolateData(Data=merge_5, Parameter=subtraction_4, Interpolation=2)
interp_2 = InterpolateData(Data=merge_6, Parameter=subtraction_4, Interpolation=2)
interp_3 = InterpolateData(Data=merge_7, Parameter=subtraction_4, Interpolation=2)
merge_8 = Merge(
    Data1=item_7.Item,
    Data2=item_7.Item1,
    Data3=avr_3,
    Data4=item_7.Item3,
    Data5=item_7.Item4,
    Data6=interp,
    Data7=interp_2,
    Data8=interp_3,
    Data9=dup_5)
conmesh = ConstructMesh(Vertices=merge_8, Faces=panel_3, Colours=merge_4)

# ---- group: graph edges (continued)
merge_9 = Merge(Data1=dup, Data2=item_6.Item)
merge_10 = Merge(Data1=dup, Data2=item_6.Item2)
merge_11 = Merge(Data1=dup, Data2=item_6.Item4)

# ---- group: graph edges / no problems if they're red
interp_4 = InterpolateData(Data=merge_9, Parameter=subtraction_3, Interpolation=2)
interp_5 = InterpolateData(Data=merge_10, Parameter=subtraction_3, Interpolation=2)
interp_6 = InterpolateData(Data=merge_11, Parameter=subtraction_3, Interpolation=2)

# ---- group: graph edges (continued)
merge_12 = Merge(
    Data1=item_6.Item,
    Data2=item_6.Item1,
    Data3=item_6.Item2,
    Data4=item_6.Item3,
    Data5=item_6.Item4,
    Data6=interp_4,
    Data7=interp_5,
    Data8=interp_6,
    Data9=dup_2)
clean_2 = CleanTree(RemoveNulls=True, RemoveInvalid=True, RemoveEmpty="true", Tree=merge_12)
conmesh_2 = ConstructMesh(Vertices=clean_2, Faces=panel_2, Colours=merge_3)

# ----
panel_4 = Panel(clean_2)
wbjoin = WeaverbirdsJoinMeshesAndWeld(Mesh=flatten([conmesh, conmesh_2]), Weld=True)
