# Grasshopper definition clipping plane anim.gh (Grasshopper 1.0.5)

pt = Point(Point(1, 3, -2))
# import a clipping plane
# from Rhino here
animation_slider = Slider(1, range=0..1)

# ----
# move Rhino plane out of sight
plane_x_dir = Slider(-800, range=-2000..2000)
plane_y_dir = Slider(0, range=-2000..2000)

section_plane = ValueList({"XY": 0, "XZ": 1, "YZ": 2, "custom": 3}, selected="XY")
reverse_sequence = ValueList({"no": 0, "yes": 1}, selected="yes")
flip_plane = ValueList({"no": 0, "yes": 1}, selected="yes")
visualize_plane = BooleanToggle(True)
visualize_direction = BooleanToggle(False)
direction_display_length = Slider(100, range=0..100)

# ---- group: z
pt_2 = Point(Point(0, 0, 1))

# ---- group: y
pt_3 = Point(Point(0, 1, 0))

# ---- group: x
pt_4 = Point(Point(1, 0, 0))

# ---- group: input custom vector here
vec = Vector(pt)

# ----
# geometries
geo = Geometry(<mesh referenced from the Rhino model>)
id = Guid(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)
pt_5 = Point(Point(0, 0, 0))
filter = StreamFilter(Gate=section_plane, Stream0=pt_2, Stream1=pt_3, Stream2=pt_4, Stream3=vec)
rev = Reverse(Vector=filter)
filter_2 = StreamFilter(Gate=flip_plane, Stream0=filter, Stream1=rev)
amp = Amplitude(Vector=filter_2, Amplitude=direction_display_length)
pl = PlaneNormal(Origin=pt_5, ZAxis=filter_2)
filter_3 = StreamFilter(Gate=visualize_direction, Stream1=amp)
bbox = BoundingBox(Content=geo, Plane=pl, UnionBox=True)  # -> Box, Box_2
pt_6 = Point(Point(0, 0, 0))
subtraction = Subtraction(A="1", B=animation_slider)
box = EvaluateBox(Box=bbox.Box, UParameter=0.5, VParameter=0.5, WParameter=0.5)  # -> Plane, Point, Include
vdisex = VectorDisplayEx(Point=pt_6, Vector=filter_3, Colour=ColourSwatch(SwatchColor=RGB(255, 255, 255)), Width=2)
# <title>
# 
# <description>
# 
# code by <author>
# 
# v <version>
# 
# © Co-de-iT 2018 _ Creative Commons Attribution-NonCommercial-ShareAlike 4.0 International License
filter_4 = StreamFilter(Gate=reverse_sequence, Stream0=animation_slider, Stream1=subtraction)
# easing animation
graph = GraphMapper(
    filter_4,
    x0=0,
    x1=1,
    y0=0,
    y1=1,
    container_name="Bezier",
    cpx=[0, 0, 0.9923480749, 1],
    cpy=[0, 0.413043499, 0.593565166, 1])
scale = Scale(Geometry=bbox.Box, Center=box.Point, Factor=Slider(1.2, range=1..2))  # -> Geometry, Transform
box_corners = BoxCorners(Box=scale.Geometry)  # -> CornerA, CornerB, CornerC, CornerD, CornerE, CornerF, CornerG, CornerH
vec2pt = Vector2Pt(PointA=box_corners.CornerA, PointB=box_corners.CornerE, Unitize=False)  # -> Vector, Length
c_script = CSharpScript(L=vec2pt.Length)  # -> D; inputs L: Double
# ---------- c_script: C# ----------
    D = new Interval(-L * 0.5, L * 0.5);
# ---------- end c_script ----------
remap = RemapNumbers(Value=graph, Source=Domain(0, 1), Target=c_script)  # -> Mapped, Clipped
amp_2 = Amplitude(Vector=vec2pt.Vector, Amplitude=remap.Mapped)
addition = Addition(A=box.Point, B=amp_2)
pl_origin = PlaneOrigin(Base=pl, Origin=addition)
pln = Plane(pl_origin)
xy = XYPlane(Origin=Point(0, 0, 0))
orient = Orient(Geometry=bbox.Box, Source=pl, Target=xy)  # -> Geometry, Transform
deplane = DeconstructPlane(Plane=pln)  # -> Origin, XAxis, YAxis, ZAxis
boxprop = BoxProperties(Box=orient.Geometry)  # -> Center, Diagonal, Area, Volume, Degeneracy
devec = DeconstructVector(Vector=boxprop.Diagonal)  # -> XComponent, YComponent, ZComponent
amp_3 = Amplitude(Vector=deplane.ZAxis, Amplitude=Slider(-1, range=-1..0))
move = Move(Geometry=pln, Motion=amp_3)  # -> Geometry, Transform

# ---- group: create custom symmetric interval
c_script_2 = CSharpScript(L=devec.XComponent)  # -> D; inputs L: Double; same code as c_script
c_script_3 = CSharpScript(L=devec.YComponent)  # -> D; inputs L: Double; same code as c_script

# ----
panel = Panel(c_script_3)
amp_4 = Amplitude(Vector=deplane.YAxis, Amplitude=plane_y_dir)
amp_5 = Amplitude(Vector=deplane.XAxis, Amplitude=plane_x_dir)
rectangle = Rectangle(Plane=pln, XSize=c_script_2, YSize=c_script_3, Radius=0)  # -> Rectangle, Length
addition_2 = Addition(A=deplane.Origin, B=amp_5, C=amp_4)
scale_2 = Scale(Geometry=rectangle.Rectangle, Center=move.Geometry, Factor=Slider(1.5, range=1..2))  # -> Geometry, Transform
pl_origin_2 = PlaneOrigin(Base=pln, Origin=addition_2)
filter_5 = StreamFilter(Gate=visualize_plane, Stream1=scale_2.Geometry)
c_script_4 = CSharpScript(id=id, y=pl_origin_2)  # -> out, A; inputs id: Guid, y: Plane
# ---------- c_script_4: C# ----------
    Rhino.DocObjects.ObjRef obj = new Rhino.DocObjects.ObjRef(id);
    Rhino.DocObjects.ClippingPlaneObject cpObj = obj.Object() as Rhino.DocObjects.ClippingPlaneObject;
    cpObj.ClippingPlaneGeometry.Plane = y;
    cpObj.CommitChanges();
# ---------- end c_script_4 ----------

# ---- group: visualize plane as planar surface
boundary = BoundarySurfaces(Edges=filter_5)
